# Grasshopper definition street decoder_WIP.gh (Grasshopper 1.0.7)

# ---- group: nodes / nodes Index
path = FilePath("D:\Desktop\IAAC\THESIS\encoding street networks\files\nodeIndex.txt")
file = ReadFile(File=path, PerLineParse=True)  # -> flatten(Content)

# ---- group: nodes / Maximum Angle
path_2 = FilePath("D:\Desktop\IAAC\THESIS\encoding street networks\files\maxAngle.txt")
file_2 = ReadFile(File=path_2, PerLineParse=True)  # -> flatten(Content)

# ---- group: nodes / Minimum Angle
path_3 = FilePath("D:\Desktop\IAAC\THESIS\encoding street networks\files\minAngle.txt")
file_3 = ReadFile(File=path_3, PerLineParse=True)  # -> flatten(Content)

# ---- group: nodes / nodes Index
path_4 = FilePath("D:\Desktop\IAAC\THESIS\encoding street networks\files\309\nodeIndex.txt")
file_4 = ReadFile(File=path_4, PerLineParse=True)  # -> flatten(Content)

# ---- group: nodes / Maximum Angle
path_5 = FilePath("D:\Desktop\IAAC\THESIS\encoding street networks\files\309\maxAngle.txt")
file_5 = ReadFile(File=path_5, PerLineParse=True)  # -> flatten(Content)

# ---- group: nodes / Minimum Angle
path_6 = FilePath("D:\Desktop\IAAC\THESIS\encoding street networks\files\309\minAngle.txt")
file_6 = ReadFile(File=path_6, PerLineParse=True)  # -> flatten(Content)

# ---- group: Edges
path_7 = FilePath("D:\Desktop\IAAC\THESIS\encoding street networks\files\edges.txt")
file_7 = ReadFile(File=path_7, PerLineParse=True)

path_8 = FilePath("D:\Desktop\IAAC\THESIS\encoding street networks\files\309\edges.txt")
file_8 = ReadFile(File=path_8, PerLineParse=True)

path_9 = FilePath("D:\Desktop\IAAC\THESIS\encoding street networks\files\bearing\400\edges.txt")
file_9 = ReadFile(File=path_9, PerLineParse=True)

# ---- group: nodes Index
path_10 = FilePath("D:\Desktop\IAAC\THESIS\encoding street networks\files\bearing\400\nodeIndex.txt")
file_10 = ReadFile(File=path_10, PerLineParse=True)  # -> flatten(Content)

# ----
panel = Panel(file_7)
panel_2 = Panel(file_3)
panel_3 = Panel(file_2)
panel_4 = Panel(file_6)
panel_5 = Panel(file_5)
split = TextSplit(Text=file_9, Separators=",")  # -> simplify(Result)
split_2 = TextSplit(Text=file_7, Separators=",")  # -> simplify(Result)
split_3 = TextSplit(Text=file_8, Separators=",")  # -> simplify(Result)
flip = FlipMatrix(Data=split)
flip_2 = FlipMatrix(Data=split_2)
flip_3 = FlipMatrix(Data=split_3)
bang = ExplodeTree(Data=flip)  # -> flatten(Branch0), flatten(Branch1), flatten(Branch2), flatten(Branch3)
bang_2 = ExplodeTree(Data=flip_2)  # -> flatten(Branch0), Branch1, Branch2
bang_3 = ExplodeTree(Data=flip_3)  # -> flatten(Branch0), flatten(Branch1), flatten(Branch2)
panel_6 = Panel(file)
panel_7 = Panel(file_4)
number_slider = Slider(3, range=0..10)  # disabled
number_slider_2 = Slider(4, range=0..10)  # disabled
number_slider_3 = Slider(366, range=0..1000)  # disabled
pt = Point(Point(32.84918906, 33.04300889, 0))
pt_2 = Point(Point(32.84918906, 33.04300889, 0))
pt_3 = Point(Point(32.84918906, 33.04300889, 0))  # disabled
pt_4 = Point(Point(32.84918906, 33.04300889, 0))
pt_5 = Point(Point(32.84918906, 33.04300889, 0))
c_script = CSharpScript(
    start=pt_2,
    seed=Slider(366, range=0..1000),
    iterations=Slider(1, range=0..10),
    edgeStart=bang_3.Branch0,
    edgeEnd=bang_3.Branch1,
    edgeLength=bang_3.Branch2,
    nodeIndex=file_4,
    maxAngle=file_5,
    minAngle=file_6)  # -> out, A; inputs start: Point3d, seed: Int32, iterations: Int32, edgeStart: list of Double, edgeEnd: list of Double, edgeLength: list of Double, nodeIndex: list of Double, maxAngle: list of Int32, minAngle: list of Int32; disabled
# ---------- c_script: C# ----------
    //create lists for storing indicies and point geometries

    List <int> indicies = new List <int>();
    List <Point3d> points = new List <Point3d>();
    indicies.Add(0);
    points.Add(start);

    // getting edge length information and endpoint indexes
    List <double> endNodes = new List <double>();
    List <double> edgeLengths = getEdgeLengths(0, edgeStart, nodeIndex, edgeEnd, edgeLength, ref endNodes);

    // constructing edges of first node
    Vector3d zeroVec = new Vector3d(1, 0, 0);

    List <Line> edges = new List <Line>();


    //adding angle info
    List <double> randomAngles = new List <double>();
    randomAngles.Add(maxAngle[0]);
    randomAngles.Add(minAngle[0]);

    Line firstLine = new Line (start, zeroVec, edgeLengths[0]);
    firstLine = rotateLine(firstLine, randomAngles[0], start);
    edges.Add(firstLine);


    for ( int i = 0; i < edgeLengths.Count - 2; i++){
      Random random = new Random(seed);
      double a = random.NextDouble() * (maxAngle[0] - minAngle[0]) + minAngle[0];
      randomAngles.Add(a);
      seed = seed + 1;
    }
    //creating lines
    for ( int i = 1; i < edgeLengths.Count; i++){
      firstLine = new Line (start, zeroVec, edgeLengths[i]);
      firstLine = rotateLine(firstLine, randomAngles[i], start);
      edges.Add(firstLine);
    }

    DataTree<Line> streets = new DataTree<Line>();
    int path = 0;
    streets.AddRange(edges, new GH_Path(path));
    //__________________________________________________________________________

    // creating list for next nodes

    List <Point3d> nextpoints = new List <Point3d>();
    List <int> nextindicies = new List <int>();

    for(int l = 0; l < endNodes.Count;l++){
      int ndindex = 0;
      for (int j = 0; j < nodeIndex.Count;j++){
        if( endNodes[l] == nodeIndex[j]){
          ndindex++;
          break;
        }
        ndindex++;
      }
      indicies.Add(ndindex);
      points.Add(new Point3d(edges[l].ToX, edges[l].ToY, 0));


      nextindicies.Add(ndindex);
      nextpoints.Add(new Point3d(edges[l].ToX, edges[l].ToY, 0));
    }


    //__________________________________________________________________________________________________
    //next loops
    for(int k = 0; k < iterations; k++){
      List <Line> tempEdges = new List <Line>();
      List <int> tempIndicies = new List <int>();
      List <Point3d> tempPoints = new List <Point3d>();

      //loop for the nodes connected to the previous
      if( nextpoints.Count > 0){
        for( int i = 0; i < nextpoints.Count; i++){

          endNodes = new List <double>();
          List <double> edgeL = getEdgeLengths(nextindicies[i], edgeStart, nodeIndex, edgeEnd, edgeLength, ref endNodes);

          List <int> secind = new List <int>();

          for ( int j = 0;j < endNodes.Count;j++){
            int ndindex = 0;
            for (int m = 0; m < nodeIndex.Count;m++){
              if( endNodes[j] == nodeIndex[m]){
                ndindex++;
                break;
              }
              ndindex++;
            }
            secind.Add(ndindex);
          }

          Vector3d ftVec = new Point3d(edges[i].ToX, edges[i].ToY, 0) - new Point3d(edges[i].FromX, edges[i].FromY, 0);

          if ( endNodes.Count > 0){
            for (int j = 0; j < endNodes.Count; j++){
              if (indicies.Contains(secind[j]) == true){
                int index = indicies.IndexOf(secind[j]);
                Line l1 = new Line(nextpoints[i], points[index]);
                tempEdges.Add(l1);
              }
              else{
                Random random = new Random(seed);
                double a = random.NextDouble() * (maxAngle[secind[j]] - minAngle[secind[j]]) + minAngle[secind[j]];
                seed = seed + 1;
                Vector3d vec = rotateVec(ftVec, a, nextpoints[i]);
                Line l1 = new Line(nextpoints[i], vec, edgeL[j]);
                tempEdges.Add(l1);

                indicies.Add(secind[j]);
                points.Add(new Point3d(l1.ToX, l1.ToY, 0));

                tempIndicies.Add(secind[j]);
                tempPoints.Add(new Point3d(l1.ToX, l1.ToY, 0));
              }
            }
          }
        }
      }

      edges = new List <Line>();
      edges.AddRange(tempEdges);

      nextpoints = new List <Point3d>();
      nextpoints.AddRange(tempPoints);

      nextindicies = new List <int>();
      nextindicies.AddRange(tempIndicies);


      path += 1;

      streets.AddRange(tempEdges, new GH_Path(path));



    }


    A = streets;
# ---------- c_script: C# additional code ----------
  public List <double> getEdgeLengths(int ndindex, List <double> edgeStart, List <double > nodeIndex, List <double> edgeEnd, List <double > edgeLength, ref List <double> endNodes){

    List<double> edgeLengths = new List<double>();
    int a = 0;

    for( int i = 0; i < edgeStart.Count; i++){
      if( nodeIndex[ndindex] == edgeStart[i]){
        edgeLengths.Add(edgeLength[a]);
        endNodes.Add(edgeEnd[a]);
      }
      a++;
    }
    a = 0;
    for( int i = 0; i < edgeEnd.Count; i++){
      if( nodeIndex[ndindex] == edgeEnd[i]){
        edgeLengths.Add(edgeLength[a]);
        endNodes.Add(edgeStart[a]);
      }
      a++;
    }

    return edgeLengths;
  }

  public Line rotateLine(Line line, double angle, Point3d ptStart){
    line.Transform(Transform.Rotation(RhinoMath.ToRadians(angle), ptStart));
    return line;
  }

  public Vector3d rotateVec(Vector3d vec, double angle, Point3d ptStart){
    vec.Transform(Transform.Rotation(RhinoMath.ToRadians(angle), ptStart));
    return vec;
  }

  public double GetRandomNumber(double minimum, double maximum)
  {
    Random random = new Random();
    return random.NextDouble() * (maximum - minimum) + minimum;
  }
# ---------- end c_script ----------
c_script_2 = CSharpScript(
    start=pt,
    seed=Slider(366, range=0..1000),
    iterations=number_slider,
    edgeStart=bang_2.Branch0,
    edgeEnd=bang_2.Branch1,
    edgeLength=bang_2.Branch2,
    nodeIndex=file,
    maxAngle=file_2,
    minAngle=file_3)  # -> out, A; inputs start: Point3d, seed: Int32, iterations: Int32, edgeStart: list of Double, edgeEnd: list of Double, edgeLength: list of Double, nodeIndex: list of Double, maxAngle: list of Int32, minAngle: list of Int32; disabled
# ---------- c_script_2: C# ----------
    //create lists for storing indicies and point geometries

    List <int> indicies = new List <int>();
    List <Point3d> points = new List <Point3d>();
    indicies.Add(0);
    points.Add(start);

    // getting edge length information and endpoint indexes
    List <double> endNodes = new List <double>();
    List <double> edgeLengths = getEdgeLengths(0, edgeStart, nodeIndex, edgeEnd, edgeLength, ref endNodes);

    // constructing edges of first node
    Vector3d zeroVec = new Vector3d(1, 0, 0);

    List <Line> edges = new List <Line>();


    //adding angle info
    List <double> randomAngles = new List <double>();
    randomAngles.Add(maxAngle[0]);
    randomAngles.Add(minAngle[0]);

    Line firstLine = new Line (start, zeroVec, edgeLengths[0]);
    firstLine = rotateLine(firstLine, randomAngles[0], start);
    edges.Add(firstLine);


    for ( int i = 0; i < edgeLengths.Count - 2; i++){
      Random random = new Random(seed);
      double a = random.NextDouble() * (maxAngle[0] - minAngle[0]) + minAngle[0];
      randomAngles.Add(a);
      seed = seed + 1;
    }
    //creating lines
    for ( int i = 1; i < edgeLengths.Count; i++){
      firstLine = new Line (start, zeroVec, edgeLengths[i]);
      firstLine = rotateLine(firstLine, randomAngles[i], start);
      edges.Add(firstLine);
    }

    DataTree<Line> streets = new DataTree<Line>();
    int path = 0;
    streets.AddRange(edges, new GH_Path(path));
    //__________________________________________________________________________

    // creating list for next nodes

    List <Point3d> nextpoints = new List <Point3d>();
    List <int> nextindicies = new List <int>();

    for(int l = 0; l < endNodes.Count;l++){
      int ndindex = 0;
      for (int j = 0; j < nodeIndex.Count;j++){
        if( endNodes[l] == nodeIndex[j]){
          ndindex++;
          break;
        }
        ndindex++;
      }
      indicies.Add(ndindex);
      points.Add(new Point3d(edges[l].ToX, edges[l].ToY, 0));


      nextindicies.Add(ndindex);
      nextpoints.Add(new Point3d(edges[l].ToX, edges[l].ToY, 0));
    }


    //__________________________________________________________________________________________________
    //next loops
    for(int k = 0; k < iterations; k++){
      List <Line> tempEdges = new List <Line>();
      List <int> tempIndicies = new List <int>();
      List <Point3d> tempPoints = new List <Point3d>();

      //loop for the nodes connected to the previous
      for( int i = 0; i < nextpoints.Count; i++){

        endNodes = new List <double>();
        List <double> edgeL = getEdgeLengths(nextindicies[i], edgeStart, nodeIndex, edgeEnd, edgeLength, ref endNodes);

        List <int> secind = new List <int>();

        for ( int j = 0;j < endNodes.Count;j++){
          int ndindex = 0;
          for (int m = 0; m < nodeIndex.Count;m++){
            if( endNodes[j] == nodeIndex[m]){
              ndindex++;
              break;
            }
            ndindex++;
          }
          secind.Add(ndindex);
        }

        Vector3d ftVec = new Point3d(edges[i].ToX, edges[i].ToY, 0) - new Point3d(edges[i].FromX, edges[i].FromY, 0);

        for (int j = 0; j < endNodes.Count; j++){
          if (indicies.Contains(secind[j]) == true){
            int index = indicies.IndexOf(secind[j]);
            Line l1 = new Line(nextpoints[i], points[index]);
            tempEdges.Add(l1);
          }
          else{
            Random random = new Random(seed);
            double a = random.NextDouble() * (maxAngle[secind[j]] - minAngle[secind[j]]) + minAngle[secind[j]];
            seed = seed + 1;
            Vector3d vec = rotateVec(ftVec, a, nextpoints[i]);
            Line l1 = new Line(nextpoints[i], vec, edgeL[j]);
            tempEdges.Add(l1);

            indicies.Add(secind[j]);
            points.Add(new Point3d(l1.ToX, l1.ToY, 0));

            tempIndicies.Add(secind[j]);
            tempPoints.Add(new Point3d(l1.ToX, l1.ToY, 0));
          }
        }
      }

      edges = new List <Line>();
      edges.AddRange(tempEdges);

      nextpoints = new List <Point3d>();
      nextpoints.AddRange(tempPoints);

      nextindicies = new List <int>();
      nextindicies.AddRange(tempIndicies);


      path += 1;

      streets.AddRange(tempEdges, new GH_Path(path));



    }


    A = streets;
# ---------- c_script_2: C# additional code ----------
  public List <double> getEdgeLengths(int ndindex, List <double> edgeStart, List <double > nodeIndex, List <double> edgeEnd, List <double > edgeLength, ref List <double> endNodes){

    List<double> edgeLengths = new List<double>();
    int a = 0;

    for( int i = 0; i < edgeStart.Count; i++){
      if( nodeIndex[ndindex] == edgeStart[i]){
        edgeLengths.Add(edgeLength[a]);
        endNodes.Add(edgeEnd[a]);
      }
      a++;
    }
    a = 0;
    for( int i = 0; i < edgeEnd.Count; i++){
      if( nodeIndex[ndindex] == edgeEnd[i]){
        edgeLengths.Add(edgeLength[a]);
        endNodes.Add(edgeStart[a]);
      }
      a++;
    }

    return edgeLengths;
  }

  public Line rotateLine(Line line, double angle, Point3d ptStart){
    line.Transform(Transform.Rotation(RhinoMath.ToRadians(angle), ptStart));
    return line;
  }

  public Vector3d rotateVec(Vector3d vec, double angle, Point3d ptStart){
    vec.Transform(Transform.Rotation(RhinoMath.ToRadians(angle), ptStart));
    return vec;
  }

  public double GetRandomNumber(double minimum, double maximum)
  {
    Random random = new Random();
    return random.NextDouble() * (maximum - minimum) + minimum;
  }
# ---------- end c_script_2 ----------
c_script_3 = CSharpScript(
    start=pt_3,
    seed=number_slider_3,
    iterations=number_slider_2,
    edgeStart=bang_3.Branch0,
    edgeEnd=bang_3.Branch1,
    edgeLength=bang_3.Branch2,
    nodeIndex=file_4,
    maxAngle=file_5,
    minAngle=file_6)  # -> out, A; inputs start: Point3d, seed: Int32, iterations: Int32, edgeStart: list of Double, edgeEnd: list of Double, edgeLength: list of Double, nodeIndex: list of Double, maxAngle: list of Int32, minAngle: list of Int32; disabled
# ---------- c_script_3: C# ----------
    //create lists for storing indicies and point geometries

    List <int> indicies = new List <int>();
    List <Point3d> points = new List <Point3d>();
    indicies.Add(1);
    points.Add(start);

    // getting edge length information and endpoint indexes
    List <double> endNodes = new List <double>();
    List <double> edgeLengths = getEdgeLengths(1, edgeStart, nodeIndex, edgeEnd, edgeLength, ref endNodes);

    // constructing edges of first node
    Vector3d zeroVec = new Vector3d(1, 0, 0);

    List <Line> edges = new List <Line>();


    //adding angle info
    List <double> randomAngles = new List <double>();
    int pi = 90;
    for (int i = 0; i < edgeLengths.Count - 1; i++){
      randomAngles.Add(pi);
      pi += 90;
    }

    Line firstLine = new Line (start, zeroVec, edgeLengths[1]);
    edges.Add(firstLine);

    //creating lines
    for ( int i = 0; i < edgeLengths.Count - 1; i++){
      firstLine = new Line (start, zeroVec, edgeLengths[i]);
      firstLine = rotateLine(firstLine, randomAngles[i], start);
      edges.Add(firstLine);
    }

    DataTree<Line> streets = new DataTree<Line>();
    int path = 0;
    streets.AddRange(edges, new GH_Path(path));
    //__________________________________________________________________________

    // creating list for next nodes

    List <Point3d> nextpoints = new List <Point3d>();
    List <int> nextindicies = new List <int>();

    for(int l = 0; l < endNodes.Count;l++){
      int ndindex = 0;
      for (int j = 0; j < nodeIndex.Count;j++){
        if( endNodes[l] == nodeIndex[j]){
          ndindex++;
          break;
        }
        ndindex++;
      }
      indicies.Add(ndindex);
      points.Add(new Point3d(edges[l].ToX, edges[l].ToY, 0));


      nextindicies.Add(ndindex);
      nextpoints.Add(new Point3d(edges[l].ToX, edges[l].ToY, 0));
    }


    //__________________________________________________________________________________________________
    //next loops
    for(int k = 0; k < iterations; k++){
      List <Line> tempEdges = new List <Line>();
      List <int> tempIndicies = new List <int>();
      List <Point3d> tempPoints = new List <Point3d>();

      //loop for the nodes connected to the previous
      if( nextpoints.Count > 0){
        for( int i = 0; i < nextpoints.Count; i++){

          endNodes = new List <double>();
          List <double> edgeL = getEdgeLengths(nextindicies[i], edgeStart, nodeIndex, edgeEnd, edgeLength, ref endNodes);

          List <int> secind = new List <int>();

          for ( int j = 0;j < endNodes.Count;j++){
            int ndindex = 0;
            for (int m = 0; m < nodeIndex.Count;m++){
              if( endNodes[j] == nodeIndex[m]){
                ndindex++;
                break;
              }
              ndindex++;
            }
            secind.Add(ndindex);
          }

          Vector3d ftVec = new Point3d(edges[i].ToX, edges[i].ToY, 0) - new Point3d(edges[i].FromX, edges[i].FromY, 0);

          if ( endNodes.Count > 0){
            int a = 90;
            for (int j = 0; j < endNodes.Count; j++){
              if (indicies.Contains(secind[j]) == true){
                int index = indicies.IndexOf(secind[j]);
                Line l1 = new Line(nextpoints[i], points[index]);
                tempEdges.Add(l1);
                a += 90;
              }
              else{
                Vector3d vec = rotateVec(ftVec, a, nextpoints[i]);
                a += 90;
                Line l1 = new Line(nextpoints[i], vec, edgeL[j]);
                tempEdges.Add(l1);

                indicies.Add(secind[j]);
                points.Add(new Point3d(l1.ToX, l1.ToY, 0));

                tempIndicies.Add(secind[j]);
                tempPoints.Add(new Point3d(l1.ToX, l1.ToY, 0));
              }
            }
          }
        }
      }

      edges = new List <Line>();
      edges.AddRange(tempEdges);

      nextpoints = new List <Point3d>();
      nextpoints.AddRange(tempPoints);

      nextindicies = new List <int>();
      nextindicies.AddRange(tempIndicies);


      path += 1;

      streets.AddRange(tempEdges, new GH_Path(path));



    }


    A = streets;
# ---------- c_script_3: C# additional code ----------
  public List <double> getEdgeLengths(int ndindex, List <double> edgeStart, List <double > nodeIndex, List <double> edgeEnd, List <double > edgeLength, ref List <double> endNodes){

    List<double> edgeLengths = new List<double>();
    int a = 0;

    for( int i = 0; i < edgeStart.Count; i++){
      if( nodeIndex[ndindex] == edgeStart[i]){
        edgeLengths.Add(edgeLength[a]);
        endNodes.Add(edgeEnd[a]);
      }
      a++;
    }
    a = 0;
    for( int i = 0; i < edgeEnd.Count; i++){
      if( nodeIndex[ndindex] == edgeEnd[i]){
        edgeLengths.Add(edgeLength[a]);
        endNodes.Add(edgeStart[a]);
      }
      a++;
    }

    return edgeLengths;
  }

  public Line rotateLine(Line line, double angle, Point3d ptStart){
    line.Transform(Transform.Rotation(RhinoMath.ToRadians(angle), ptStart));
    return line;
  }

  public Vector3d rotateVec(Vector3d vec, double angle, Point3d ptStart){
    vec.Transform(Transform.Rotation(RhinoMath.ToRadians(angle), ptStart));
    return vec;
  }

  public double GetRandomNumber(double minimum, double maximum)
  {
    Random random = new Random();
    return random.NextDouble() * (maximum - minimum) + minimum;
  }
# ---------- end c_script_3 ----------
c_script_4 = CSharpScript(
    start=pt_4,
    iterations=Slider(0, range=0..10),
    edgeStart=bang.Branch0,
    edgeEnd=bang.Branch1,
    edgeLength=bang.Branch2,
    edgeBearing=bang.Branch3,
    nodeIndex=file_10)  # -> out, A; inputs start: Point3d, iterations: Int32, edgeStart: list of Double, edgeEnd: list of Double, edgeLength: list of Double, edgeBearing: list of Double, nodeIndex: list of Double
# ---------- c_script_4: C# ----------
    //create lists for storing indicies and point geometries

    List <int> indicies = new List <int>();
    List <Point3d> points = new List <Point3d>();
    indicies.Add(1);
    points.Add(start);

    // getting edge length information and endpoint indexes
    List <double> endNodes = new List <double>();
    List <double> edgeBearings = new List <double> ();
    List <double> edgeLengths = getEdgeLengths(1, edgeStart, nodeIndex, edgeEnd, edgeLength, edgeBearing, ref endNodes, ref edgeBearings);

    // constructing edges of first node
    Vector3d zeroVec = new Vector3d(0, 1, 0);

    List <Line> edges = new List <Line>();

    //creating lines
    for ( int i = 0; i < edgeLengths.Count; i++){
      Line firstLine = new Line (start, zeroVec, edgeLengths[i]);
      firstLine = rotateLine(firstLine, edgeBearings[i], start);
      edges.Add(firstLine);
    }

    DataTree<Line> streets = new DataTree<Line>();
    int path = 0;
    streets.AddRange(edges, new GH_Path(path));
    //__________________________________________________________________________

    // creating list for next nodes

    List <Point3d> nextpoints = new List <Point3d>();
    List <int> nextindicies = new List <int>();

    List <Point3d> prevpoints = new List <Point3d>();
    List <int> previndicies = new List <int>();

    for(int l = 0; l < endNodes.Count;l++){
      int ndindex = 0;
      for (int j = 0; j < nodeIndex.Count;j++){
        if( endNodes[l] == nodeIndex[j]){
          ndindex++;
          break;
        }
        ndindex++;
      }
      indicies.Add(ndindex);
      points.Add(new Point3d(edges[l].ToX, edges[l].ToY, 0));

      previndicies.Add(1);
      prevpoints.Add(start);


      nextindicies.Add(ndindex);
      nextpoints.Add(new Point3d(edges[l].ToX, edges[l].ToY, 0));
    }


    //__________________________________________________________________________________________________
    //next loops
    for(int k = 0; k < iterations; k++){
      List <Line> tempEdges = new List <Line>();
      List <int> tempIndicies = new List <int>();
      List <Point3d> tempPoints = new List <Point3d>();

      //loop for the nodes connected to the previous
      if( nextpoints.Count > 0){
        for( int i = 0; i < nextpoints.Count; i++){

          endNodes = new List <double>();
          edgeBearings = new List <double> ();
          List <double> edgeL = getEdgeLengths(nextindicies[i], edgeStart, nodeIndex, edgeEnd, edgeLength, edgeBearing, ref endNodes, ref edgeBearings);

          foreach ( var prev in previndicies){
            endNodes.Remove(nodeIndex[prev]);
          }

          List <int> secind = new List <int>();

          for ( int j = 0;j < endNodes.Count;j++){
            int ndindex = 0;
            for (int m = 0; m < nodeIndex.Count;m++){
              ndindex++;
              if( endNodes[j] == nodeIndex[m]){
                break;
              }

            }
            secind.Add(ndindex);
          }


          if ( endNodes.Count > 0){
            for (int j = 0; j < endNodes.Count; j++){
              if (indicies.Contains(secind[j]) == true){
                int index = indicies.IndexOf(secind[j]);
                Line l1 = new Line(nextpoints[i], points[index]);
                tempEdges.Add(l1);
              }
              else{
                Line l1 = new Line (nextpoints[i], zeroVec, edgeL[j]);
                l1 = rotateLine(l1, edgeBearings[j], nextpoints[i]);

                tempEdges.Add(l1);

                indicies.Add(secind[j]);
                points.Add(new Point3d(l1.ToX, l1.ToY, 0));

                tempIndicies.Add(secind[j]);
                tempPoints.Add(new Point3d(l1.ToX, l1.ToY, 0));
              }
            }
          }
        }
      }

      edges = new List <Line>();
      edges.AddRange(tempEdges);

      previndicies = new List <int>();
      previndicies.AddRange(nextindicies);

      prevpoints = new List <Point3d>();
      prevpoints.AddRange(nextpoints);

      nextpoints = new List <Point3d>();
      nextpoints.AddRange(tempPoints);

      nextindicies = new List <int>();
      nextindicies.AddRange(tempIndicies);


      path += 1;

      streets.AddRange(tempEdges, new GH_Path(path));



    }


    A = streets;
# ---------- c_script_4: C# additional code ----------
  public List <double> getEdgeLengths(int ndindex, List <double> edgeStart, List <double > nodeIndex, List <double> edgeEnd, List <double > edgeLength, List <double> edgeBearing, ref List <double> endNodes, ref List <double> edgeBearings){

    List<double> edgeLengths = new List<double>();
    int a = 0;

    for( int i = 0; i < edgeStart.Count; i++){
      if( nodeIndex[ndindex] == edgeStart[i]){
        edgeLengths.Add(edgeLength[a]);
        edgeBearings.Add(360 - edgeBearing[a]);
        endNodes.Add(edgeEnd[a]);
      }
      a++;
    }
    a = 0;
    for( int i = 0; i < edgeEnd.Count; i++){
      if( nodeIndex[ndindex] == edgeEnd[i]){
        edgeLengths.Add(edgeLength[a]);
        edgeBearings.Add(360 - (180 + edgeBearing[a]));
        endNodes.Add(edgeStart[a]);
      }
      a++;
    }

    return edgeLengths;
  }

  public Line rotateLine(Line line, double angle, Point3d ptStart){
    line.Transform(Transform.Rotation(RhinoMath.ToRadians(angle), ptStart));
    return line;
  }

  public Vector3d rotateVec(Vector3d vec, double angle, Point3d ptStart){
    vec.Transform(Transform.Rotation(RhinoMath.ToRadians(angle), ptStart));
    return vec;
  }

  public double GetRandomNumber(double minimum, double maximum)
  {
    Random random = new Random();
    return random.NextDouble() * (maximum - minimum) + minimum;
  }
# ---------- end c_script_4 ----------
c_script_5 = CSharpScript(
    start=pt_5,
    iterations=Slider(0, range=0..10),
    edgeStart=bang.Branch0,
    edgeEnd=bang.Branch1,
    edgeLength=bang.Branch2,
    edgeBearing=bang.Branch3,
    nodeIndex=file_10)  # -> out, A; inputs start: Point3d, iterations: Int32, edgeStart: list of Double, edgeEnd: list of Double, edgeLength: list of Double, edgeBearing: list of Double, nodeIndex: list of Double
# ---------- c_script_5: C# ----------
    //create lists for storing indicies and point geometries

    List <int> indicies = new List <int>();
    List <Point3d> points = new List <Point3d>();
    indicies.Add(1);
    points.Add(start);

    // getting edge length information and endpoint indexes
    List <double> endNodes = new List <double>();
    List <double> edgeBearings = new List <double> ();
    List <double> edgeLengths = getEdgeLengths(1, edgeStart, nodeIndex, edgeEnd, edgeLength, edgeBearing, ref endNodes, ref edgeBearings);

    // constructing edges of first node
    Vector3d zeroVec = new Vector3d(0, 1, 0);

    List <Line> edges = new List <Line>();

    //creating lines
    for ( int i = 0; i < edgeLengths.Count; i++){
      Line firstLine = new Line (start, zeroVec, edgeLengths[i]);
      firstLine = rotateLine(firstLine, edgeBearings[i], start);
      edges.Add(firstLine);
    }

    DataTree<Line> streets = new DataTree<Line>();
    int path = 0;
    streets.AddRange(edges, new GH_Path(path));
    //__________________________________________________________________________

    // creating list for next nodes

    List <Point3d> nextpoints = new List <Point3d>();
    List <int> nextindicies = new List <int>();

    for(int l = 0; l < endNodes.Count;l++){
      int ndindex = 0;
      for (int j = 0; j < nodeIndex.Count;j++){
        if( endNodes[l] == nodeIndex[j]){
          ndindex++;
          break;
        }
        ndindex++;
      }
      indicies.Add(ndindex);
      points.Add(new Point3d(edges[l].ToX, edges[l].ToY, 0));


      nextindicies.Add(ndindex);
      nextpoints.Add(new Point3d(edges[l].ToX, edges[l].ToY, 0));
    }


    //__________________________________________________________________________________________________
    //next loops
    for(int k = 0; k < iterations; k++){
      List <Line> tempEdges = new List <Line>();
      List <int> tempIndicies = new List <int>();
      List <Point3d> tempPoints = new List <Point3d>();

      //loop for the nodes connected to the previous
      if( nextpoints.Count > 0){
        for( int i = 0; i < nextpoints.Count; i++){

          endNodes = new List <double>();
          edgeBearings = new List <double> ();
          List <double> edgeL = getEdgeLengths(nextindicies[i], edgeStart, nodeIndex, edgeEnd, edgeLength, edgeBearing, ref endNodes, ref edgeBearings);

          List <int> secind = new List <int>();

          for ( int j = 0;j < endNodes.Count;j++){
            int ndindex = 0;
            for (int m = 0; m < nodeIndex.Count;m++){
              if( endNodes[j] == nodeIndex[m]){
                ndindex++;
                break;
              }
              ndindex++;
            }
            secind.Add(ndindex);
          }


          if ( endNodes.Count > 0){
            for (int j = 0; j < endNodes.Count; j++){

              Line l1 = new Line (nextpoints[i], zeroVec, edgeL[j]);
              l1 = rotateLine(l1, edgeBearings[j], nextpoints[i]);

              tempEdges.Add(l1);

              indicies.Add(secind[j]);
              points.Add(new Point3d(l1.ToX, l1.ToY, 0));

              tempIndicies.Add(secind[j]);
              tempPoints.Add(new Point3d(l1.ToX, l1.ToY, 0));

            }
          }
        }
      }

      edges = new List <Line>();
      edges.AddRange(tempEdges);

      nextpoints = new List <Point3d>();
      nextpoints.AddRange(tempPoints);

      nextindicies = new List <int>();
      nextindicies.AddRange(tempIndicies);


      path += 1;

      streets.AddRange(tempEdges, new GH_Path(path));



    }


    A = streets;
# ---------- c_script_5: C# additional code ----------
  public List <double> getEdgeLengths(int ndindex, List <double> edgeStart, List <double > nodeIndex, List <double> edgeEnd, List <double > edgeLength, List <double> edgeBearing, ref List <double> endNodes, ref List <double> edgeBearings){

    List<double> edgeLengths = new List<double>();
    int a = 0;

    for( int i = 0; i < edgeStart.Count; i++){
      if( nodeIndex[ndindex] == edgeStart[i]){
        edgeLengths.Add(edgeLength[a]);
        edgeBearings.Add(360 - edgeBearing[a]);
        endNodes.Add(edgeEnd[a]);
      }
      a++;
    }
    a = 0;
    for( int i = 0; i < edgeEnd.Count; i++){
      if( nodeIndex[ndindex] == edgeEnd[i]){
        edgeLengths.Add(edgeLength[a]);
        edgeBearings.Add(360 - (180 + edgeBearing[a]));
        endNodes.Add(edgeStart[a]);
      }
      a++;
    }

    return edgeLengths;
  }

  public Line rotateLine(Line line, double angle, Point3d ptStart){
    line.Transform(Transform.Rotation(RhinoMath.ToRadians(angle), ptStart));
    return line;
  }

  public Vector3d rotateVec(Vector3d vec, double angle, Point3d ptStart){
    vec.Transform(Transform.Rotation(RhinoMath.ToRadians(angle), ptStart));
    return vec;
  }

  public double GetRandomNumber(double minimum, double maximum)
  {
    Random random = new Random();
    return random.NextDouble() * (maximum - minimum) + minimum;
  }
# ---------- end c_script_5 ----------
item = ListItem(List=bang_2.Branch0, Index=0, Wrap=True)
data = Data(c_script_2.A)  # disabled
data_2 = Data(c_script.A)
data_3 = Data(c_script_3.A)  # disabled
pt_6 = Point(Point(32.84918906, 33.04300889, 0))
data_4 = Data(c_script_4.A)
data_5 = Data(c_script_5.A)
panel_8 = Panel(bang_2.Branch0)
panel_9 = Panel(bang_2.Branch1)
c_script_6 = CSharpScript(
    start=pt_6,
    iterations=Slider(0, range=0..10),
    edgeStart=bang.Branch0,
    edgeEnd=bang.Branch1,
    edgeLength=bang.Branch2,
    edgeBearing=bang.Branch3,
    nodeIndex=file_10)  # -> out, A; inputs start: Point3d, iterations: Int32, edgeStart: list of Double, edgeEnd: list of Double, edgeLength: list of Double, edgeBearing: list of Double, nodeIndex: list of Double
# ---------- c_script_6: C# ----------
    //create lists for storing indicies and point geometries

    List <int> indicies = new List <int>();
    List <Point3d> points = new List <Point3d>();
    indicies.Add(1);
    points.Add(start);

    // getting edge length information and endpoint indexes
    List <double> endNodes = new List <double>();
    List <double> edgeBearings = new List <double> ();
    List <double> edgeLengths = getEdgeLengths(1, edgeStart, nodeIndex, edgeEnd, edgeLength, edgeBearing, ref endNodes, ref edgeBearings);

    // constructing edges of first node
    Vector3d zeroVec = new Vector3d(0, 1, 0);

    List <Line> edges = new List <Line>();

    //creating lines
    for ( int i = 0; i < edgeLengths.Count; i++){
      Line firstLine = new Line (start, zeroVec, edgeLengths[i]);
      firstLine = rotateLine(firstLine, edgeBearings[i], start);
      edges.Add(firstLine);
    }

    DataTree<Line> streets = new DataTree<Line>();
    int path = 0;
    streets.AddRange(edges, new GH_Path(path));
    //__________________________________________________________________________

    // creating list for next nodes

    List <Point3d> nextpoints = new List <Point3d>();
    List <int> nextindicies = new List <int>();

    List <Point3d> prevpoints = new List <Point3d>();
    List <int> previndicies = new List <int>();

    for(int l = 0; l < endNodes.Count;l++){
      int ndindex = 0;
      for (int j = 0; j < nodeIndex.Count;j++){
        if( endNodes[l] == nodeIndex[j]){
          ndindex++;
          break;
        }
        ndindex++;
      }
      indicies.Add(ndindex);
      points.Add(new Point3d(edges[l].ToX, edges[l].ToY, 0));

      previndicies.Add(1);
      prevpoints.Add(start);


      nextindicies.Add(ndindex);
      nextpoints.Add(new Point3d(edges[l].ToX, edges[l].ToY, 0));
    }


    //__________________________________________________________________________________________________
    //next loops
    for(int k = 0; k < iterations; k++){
      List <Line> tempEdges = new List <Line>();
      List <int> tempIndicies = new List <int>();
      List <Point3d> tempPoints = new List <Point3d>();

      //loop for the nodes connected to the previous
      if( nextpoints.Count > 0){
        for( int i = 0; i < nextpoints.Count; i++){

          endNodes = new List <double>();
          edgeBearings = new List <double> ();
          List <double> edgeL = getEdgeLengths(nextindicies[i], edgeStart, nodeIndex, edgeEnd, edgeLength, edgeBearing, ref endNodes, ref edgeBearings);

         

          foreach ( var prev in previndicies){
            endNodes.Remove(nodeIndex[prev]);
            edgeBearings.Remove(edgeBearing[prev]);
            //edgeL.Remove(edgeLength[prev]);
          }

          List <int> secind = new List <int>();

          for ( int j = 0;j < endNodes.Count;j++){
            int ndindex = 0;
            for (int m = 0; m < nodeIndex.Count;m++){
              ndindex++;
              if( endNodes[j] == nodeIndex[m]){
                break;
              }

            }
            secind.Add(ndindex);
          }


          if ( endNodes.Count > 0){
            for (int j = 0; j < endNodes.Count; j++){


              Line l1 = new Line (nextpoints[i], zeroVec, edgeL[j]);
              l1 = rotateLine(l1, edgeBearings[j], nextpoints[i]);

              tempEdges.Add(l1);

              indicies.Add(secind[j]);
              points.Add(new Point3d(l1.ToX, l1.ToY, 0));

              tempIndicies.Add(secind[j]);
              tempPoints.Add(new Point3d(l1.ToX, l1.ToY, 0));

            }
          }
        }
      }

      edges = new List <Line>();
      edges.AddRange(tempEdges);

      //previndicies = new List <int>();
      previndicies.AddRange(nextindicies);

      //prevpoints = new List <Point3d>();
      prevpoints.AddRange(nextpoints);

      nextpoints = new List <Point3d>();
      nextpoints.AddRange(tempPoints);

      nextindicies = new List <int>();
      nextindicies.AddRange(tempIndicies);


      path += 1;

      streets.AddRange(tempEdges, new GH_Path(path));



    }


    A = streets;
# ---------- c_script_6: C# additional code ----------
  public List <double> getEdgeLengths(int ndindex, List <double> edgeStart, List <double > nodeIndex, List <double> edgeEnd, List <double > edgeLength, List <double> edgeBearing, ref List <double> endNodes, ref List <double> edgeBearings){

    List<double> edgeLengths = new List<double>();
    int a = 0;

    for( int i = 0; i < edgeStart.Count; i++){
      if( nodeIndex[ndindex] == edgeStart[i]){
        edgeLengths.Add(edgeLength[a]);
        edgeBearings.Add(360 - edgeBearing[a]);
        endNodes.Add(edgeEnd[a]);
      }
      a++;
    }
    a = 0;
    for( int i = 0; i < edgeEnd.Count; i++){
      if( nodeIndex[ndindex] == edgeEnd[i]){
        edgeLengths.Add(edgeLength[a]);
        edgeBearings.Add(360 - (180 + edgeBearing[a]));
        endNodes.Add(edgeStart[a]);
      }
      a++;
    }

    return edgeLengths;
  }

  public Line rotateLine(Line line, double angle, Point3d ptStart){
    line.Transform(Transform.Rotation(RhinoMath.ToRadians(angle), ptStart));
    return line;
  }

  public Vector3d rotateVec(Vector3d vec, double angle, Point3d ptStart){
    vec.Transform(Transform.Rotation(RhinoMath.ToRadians(angle), ptStart));
    return vec;
  }

  public double GetRandomNumber(double minimum, double maximum)
  {
    Random random = new Random();
    return random.NextDouble() * (maximum - minimum) + minimum;
  }
# ---------- end c_script_6 ----------
data_6 = Data(c_script_6.A)
